# Grasshopper definition Components.gh (Grasshopper 1.0.8)
# plug-ins: eleFront

# Bridge Point A and Point B
number_slider = Slider(2, range=0..10)
# Connectivity
geo = Geometry([<curve referenced from the Rhino model> x9])

# ---- group: Checks if closed curve
area = Area(Geometry=geo)  # -> Area, Centroid
null = NullItem(Item=area.Area)  # -> NullFlags, InvalidFlags, Description
dispatch = Dispatch(List=geo, DispatchPattern=null.NullFlags)  # -> ListA, ListB

# ----
bridge_width = Number(number_slider)
point_a = Point(<point referenced from the Rhino model>)
point_b = Point(<point referenced from the Rhino model>)

# ---- group: RH_Input
# copyright: Thornton Tomasetti, Inc.
# Author:
# CSchafer@ThorntonTomasetti.com
# Date: XX/XX/2025
# Revision: X
# GH: 1.0.0007
# Description:
pt = Point(Point(0, 0, 0))

pt_2 = Point(Point(0, 0, 0))

# ---- group: Input
pt_3 = Point(Point(0, 0, 0))

pt_4 = Point(Point(0, 0, 0))

# ----
ln = Line(StartPoint=point_a, EndPoint=point_b)  # -> simplify(Line)
panel = Panel("""0
1""")

# ---- group: Operation
pt_5 = Point(Point(0, 0, 0))

pt_6 = Point(Point(0, 0, 0))

# ----
pframe = PerpFrame(Curve=reparameterize(ln), Parameter=panel)
rhatt = GetRhinoAttributes(Geometry=dispatch.ListB, fullpath=False)  # -> Name, Layer, Color, MaterialName, SourceFile

# ---- group: Output
pt_7 = Point(Point(0, 0, 0))

pt_8 = Point(Point(0, 0, 0))

# ----
deplane = DeconstructPlane(Plane=pframe)  # -> Origin, XAxis, YAxis, ZAxis

# ---- group: Visualization
pt_9 = Point(Point(0, 0, 0))

pt_10 = Point(Point(0, 0, 0))

# ----
area_2 = Area(Geometry=dispatch.ListB)  # -> Area, Centroid
cset = CreateSet(List=rhatt.Color)  # -> Set, Map
tstat = TreeStatistics(Tree=cset.Set)  # -> Paths, Length, Count

# ---- group: Perp Vector Road Width
multiplication = Multiplication(A=bridge_width, B=deplane.YAxis)
multiplication_2 = Multiplication(A=bridge_width, B=deplane.YAxis)  # -> simplify(graft(Result))
multiplication_3 = Multiplication(A=multiplication, B=-1)  # -> simplify(graft(Result))

# ----
series = Series(Start=0, Step=1, Count=tstat.Length)
associated_color_index = Data(series)
py3 = Python3Script(Pts=area_2.Centroid, IDs=rhatt.Name, Index=cset.Map)  # -> out, Distance, Connection, FromID, ToID, FromIndex, ToIndex, PairLabel, Notes; inputs Pts: list of Point3d, IDs: list of String, Index: list of Int32
# ---------- py3: Python ----------
"""
Grasshopper Python Script

Purpose:
    Calculates the distance between each unique pair of input points.

    Each point/object has:
        1. A point location
        2. An identification number
        3. An associated index, such as a color/category index

    The script keeps track of both objects involved in each connection.

Inputs:
    Pts   : List of points
    IDs   : List of identification numbers, one per point
    Index : List of associated index/color/category values, one per point

Outputs:
    Distance  : Distance between each unique point pair
    Connection: Line between each unique point pair
    FromID    : ID of the first object in the pair
    ToID      : ID of the second object in the pair
    FromIndex : Associated index of the first object in the pair
    ToIndex   : Associated index of the second object in the pair
    PairLabel : Readable label describing each connection
    Notes     : Error/warning/status messages
"""

import Rhino.Geometry as rg


# ------------------------------------------------------------
# Helper functions
# ------------------------------------------------------------

def flatten_input(data):
    """
    Converts Grasshopper input into a simple Python list.

    This lets the script work with:
        - single items
        - normal lists
        - tuples
        - Grasshopper DataTrees
    """

    if data is None:
        return []

    if isinstance(data, list) or isinstance(data, tuple):
        return list(data)

    if hasattr(data, "Branches"):
        flattened = []

        for branch in data.Branches:
            for item in branch:
                flattened.append(item)

        return flattened

    return [data]


def get_point3d(item):
    """
    Converts common Grasshopper/Rhino point-like inputs into Point3d.

    Supported input types:
        - Rhino.Geometry.Point3d
        - Rhino.Geometry.Point, using its Location property
    """

    if item is None:
        return None

    if isinstance(item, rg.Point3d):
        return item

    if isinstance(item, rg.Point):
        return item.Location

    if hasattr(item, "Location") and isinstance(item.Location, rg.Point3d):
        return item.Location

    return None


# ------------------------------------------------------------
# Default outputs
# ------------------------------------------------------------

Distance = []
Connection = []
FromID = []
ToID = []
FromIndex = []
ToIndex = []
PairLabel = []
Notes = []


# ------------------------------------------------------------
# Normalize inputs
# ------------------------------------------------------------

pts_input = flatten_input(Pts)
ids_input = flatten_input(IDs)
index_input = flatten_input(Index)


# ------------------------------------------------------------
# Validate inputs
# ------------------------------------------------------------

if len(pts_input) == 0:
    Notes.append("Error: No points were provided.")

elif len(ids_input) == 0:
    Notes.append("Error: No IDs were provided.")

elif len(index_input) == 0:
    Notes.append("Error: No Index values were provided.")

elif len(pts_input) != len(ids_input):
    Notes.append(
        "Error: Number of points does not match number of IDs. "
        "Points: {0}, IDs: {1}".format(len(pts_input), len(ids_input))
    )

elif len(pts_input) != len(index_input):
    Notes.append(
        "Error: Number of points does not match number of Index values. "
        "Points: {0}, Index values: {1}".format(len(pts_input), len(index_input))
    )

else:
    points = []
    ids = []
    indices = []

    invalid_point_indices = []

    for i in range(len(pts_input)):
        pt = get_point3d(pts_input[i])

        if pt is None:
            invalid_point_indices.append(i)
        else:
            points.append(pt)
            ids.append(ids_input[i])
            indices.append(index_input[i])

    if len(invalid_point_indices) > 0:
        Notes.append(
            "Error: Invalid point input found at item index/indices: {0}".format(
                invalid_point_indices
            )
        )

    elif len(points) < 2:
        Notes.append(
            "Error: At least two valid points are required to calculate distances."
        )

    else:
        count = len(points)

        # ------------------------------------------------------------
        # Calculate unique unordered pairs
        #
        # This avoids:
        #   - self-distances, such as 1-1
        #   - duplicate reverse pairs, such as 1-2 and 2-1
        #
        # Example for four objects:
        #   1-2
        #   1-3
        #   1-4
        #   2-3
        #   2-4
        #   3-4
        # ------------------------------------------------------------

        for i in range(count):
            for j in range(i + 1, count):

                pt_a = points[i]
                pt_b = points[j]

                id_a = ids[i]
                id_b = ids[j]

                index_a = indices[i]
                index_b = indices[j]

                dist = pt_a.DistanceTo(pt_b)
                line = rg.Line(pt_a, pt_b)

                Distance.append(dist)
                Connection.append(line)

                FromID.append(id_a)
                ToID.append(id_b)

                FromIndex.append(index_a)
                ToIndex.append(index_b)

                PairLabel.append(
                    "ID {0} | Index {1}  <-->  ID {2} | Index {3} | Distance {4}".format(
                        id_a,
                        index_a,
                        id_b,
                        index_b,
                        round(dist, 4)
                    )
                )

        expected_connection_count = count * (count - 1) / 2

        Notes.append(
            "Success: Calculated {0} unique connections from {1} input objects.".format(
                len(Distance),
                count
            )
        )

        Notes.append(
            "Expected unique pair count: {0}.".format(
                int(expected_connection_count)
            )
        )

        Notes.append(
            "Self-distances and duplicate reverse pairs were automatically excluded."
        )
# ---------- end py3 ----------

# ---- group: Bridge Width
merge = Merge(Data1=point_a, Data2=point_b)  # -> graft(Result)
move = Move(Geometry=merge, Motion=[multiplication_2, multiplication_3])  # -> Geometry, Transform
flip = FlipMatrix(Data=move.Geometry)

# ----
color = Data(cset.Set)
intcrv = Interpolate(Vertices=move.Geometry, Degree=3, Periodic=False, KnotStyle=1)  # -> Curve, Length, Domain
intcrv_2 = Interpolate(Vertices=flip, Degree=3, Periodic=False, KnotStyle=1)  # -> Curve, Length, Domain
join = JoinCurves(Curves=flatten([intcrv_2.Curve, intcrv.Curve]), Preserve=False)  # -> simplify(Curves)
boundary = BoundarySurfaces(Edges=join)

# ---- group: Bridge Surfaces
geo_2 = Geometry(boundary)
